# Grasshopper definition lines.gh (Grasshopper 1.0.7)

path = FilePath("D:\2022-23\Okul\Dersler\BS723\[07][05] Results\results\20230706073443_record_20230706073443.csv")
file = ReadFile(File=path, PerLineParse=True)
tmatch = MatchText(Text=file, Pattern="timeseries", Case=True)
equals = Equality(FirstNumber=tmatch, SecondNumber="True")  # -> Equality, Inequality
cull = CullPattern(List=tmatch, CullPattern=equals.Equality)
index = ItemIndex(List=tmatch, Item=cull)
dispatch = Dispatch(List=file, DispatchPattern=tmatch)  # -> ListA, ListB
split = SplitList(List=index, Index=1)  # -> ListA, ListB
partition = PartitionList(List=dispatch.ListB, Size=split.ListA)
number_slider = Slider(650, range=0..1000)
split_2 = TextSplit(Text=partition, Separators=",")
item = ListItem(List=split_2, Index=0, Wrap=True)
item_2 = ListItem(List=split_2, Index=2, Wrap=True)
item_3 = ListItem(List=split_2, Index=1, Wrap=True)
multiplication = Multiplication(A=item, B=number_slider)
multiplication_2 = Multiplication(A=item_3, B=number_slider)
multiplication_3 = Multiplication(A=item_2, B=number_slider)
pt = ConstructPoint(XCoordinate=multiplication, YCoordinate=multiplication_2, ZCoordinate=multiplication_3)  # -> simplify(flatten(Point))
split_3 = SplitList(List=pt, Index=1)  # -> ListA, ListB
ln = Line(StartPoint=pt, EndPoint=split_3.ListB)
culln = CullNth(List=ln, CullFrequency=split.ListA)
